# Grasshopper definition ESP32 ws.gh (Grasshopper 1.0.7)

trigger = Trigger(Interval=50, TimerInterval=50, Target=websocket_client_sender)
websocket_client_start = WebsocketClientStart(Address="ws://192.168.247.239/ws", InitalMessage="Hello World", Reset=Button())
websocket_client_receiver = WebsocketClientReceiver(WebsocketObjects=websocket_client_start, AutoUpdate=True)  # -> Message, Status
websocket_client_sender = WebsocketClientSender(WebsocketObjects=websocket_client_start, Message="Yo")
python = GhPythonScript(x=websocket_client_receiver.Message)  # -> out, b
# ---------- python: Python ----------
import json

sensors = json.loads(x)
he = int(sensors['s1'])

if he > 2048:
    b = he
else:
    b = -he
# ---------- end python ----------
cir = Circle(Plane=PlaneXY(0, 0, 0), Radius=Slider(77, range=0..100))
panel = Panel(websocket_client_receiver.Message)
Z = UnitZ(Factor=python.b)
panel_2 = Panel(python.b)
extr = Extrude(Base=cir, Direction=Z)
